# Dynamo graph covid_정리.dyn (Dynamo 2.10.1.3976)

# group: 바이러스 외피
code_block = CodeBlock { 0; }
byCoordinates = Point.ByCoordinates(x=code_block, y=code_block, z=code_block)
code_block_2 = CodeBlock { 100; }
byCenterPointRadius = Sphere.ByCenterPointRadius(centerPoint=byCoordinates, radius=code_block_2)
explode = Geometry.Explode(geometry=byCenterPointRadius)

바이러스몸통 = CodeBlock(바이러스몸통=byCenterPointRadius) { 바이러스몸통; }

# group: 스파이크 위치 생성
code_block_3 = CodeBlock(i=explode) { i[0]; }
code_block_4 = CodeBlock { 0..2..0.1; }
code_block_5 = CodeBlock { -1; }
dropItems = List.DropItems(list=code_block_4, amount=code_block_5)
pointAtParameter = Surface.PointAtParameter(surface=code_block_3, u=dropItems, v=dropItems, lacing=CrossProduct)

# group: 해당 위치에 스파이크 줄기 생성
code_block_6 = CodeBlock(i=pointAtParameter) { i; }
# note: 원의 중심에서 각 스파이크까지 방사형으로 뻗어나가는 벡터
byTwoPoints = Vector.ByTwoPoints(start=byCoordinates, end=code_block_6)
code_block_7 = CodeBlock { 0.01*20; }
scale = Vector.Scale(vector=byTwoPoints, scale_factor=code_block_7)
translate = Geometry.Translate(geometry=code_block_6, direction=scale)
code_block_8 = CodeBlock { 5; 3; }
byPointsRadii = Cone.ByPointsRadii(startPoint=code_block_6, endPoint=translate, startRadius=code_block_8.out0, endRadius=code_block_8.out1)

# group: 스파이크의 넓적한 끝부분 만들기
code_block_9 = CodeBlock(i=translate) { i; }
code_block_10 = CodeBlock { 0.01*5; }
scale_2 = Vector.Scale(vector=byTwoPoints, scale_factor=code_block_10)
translate_2 = Geometry.Translate(geometry=code_block_9, direction=scale_2)
code_block_11 = CodeBlock { 8; 8; }
byPointsRadii_2 = Cone.ByPointsRadii(startPoint=code_block_9, endPoint=translate_2, startRadius=code_block_11.out0, endRadius=code_block_11.out1)

# group: 레빗 DirectShape로 만들어주기
바이러스몸통_2 = CodeBlock(바이러스몸통=바이러스몸통) { 바이러스몸통; }
스파이크줄기 = CodeBlock(스파이크줄기=byPointsRadii) { 스파이크줄기; }
스파이크끝부분 = CodeBlock(스파이크끝부분=byPointsRadii_2) { 스파이크끝부분; }
join = List.Join(list0=바이러스몸통_2, list1=스파이크줄기, list2=스파이크끝부분)
flatten = List.Flatten(list=join)
byUnion = Solid.ByUnion(solids=flatten)
categories = Categories("OST_GenericModel")
code_block_12 = CodeBlock { "covid1"; }
byGeometry = DirectShape.ByGeometry(geometry=byUnion, category=categories, name=code_block_12)
