# Dynamo graph Home.dyn (Dynamo 2.12.0.5650)

python_script = Python()  # CPython3; unwired: IN[0]
# ---------- python_script.python (26 lines) ----------
# Load the Python Standard and DesignScript Libraries
import os
python_rootpath = os.getenv('LOCALAPPDATA')+'\Programs\Python'
file_list = os.listdir(python_rootpath)
python_version = file_list[-1]
import sys
import clr
clr.AddReference('ProtoGeometry')

sys.path.append(os.getenv('LOCALAPPDATA').replace('\\','\\\\') + f'\Programs\Python\{python_version}\Lib\site-packages')


sys.path.append(r'C:\Users\pjmk0\AppData\Roaming\Dynamo\Dynamo Revit\2.12\packages\archi-lab.net\bin')
## clr.AddReference('archi-lab.net')



from Autodesk.DesignScript.Geometry import *

# The inputs to this node will be stored as a list in the IN variables.
dataEnteringNode = IN

# Place your code below this line

# Assign your output to the OUT variable.
OUT = 0
# ----------------------------------------
