# Dynamo graph dynamo_obj3.dyn (Dynamo 2.12.0.5650)

# group: 박스 준비
code_block = CodeBlock { 0..40..10; }
byCoordinates = Point.ByCoordinates(x=code_block, y=code_block, lacing=CrossProduct)
code_block_2 = CodeBlock()
# ---------- code_block_2.designscript (3 lines) ----------
[
5,7,6,6,8
];
# ----------------------------------------
byLengths = Cuboid.ByLengths(origin=byCoordinates, height=code_block_2)
height = Cuboid.Height(cuboid=byLengths)
code_block_3 = CodeBlock { 2; }
div = height / code_block_3
translate = Geometry.Translate(geometry=byLengths, zTranslation=div)
flatten = List.Flatten(list=translate)

박스형상 = CodeBlock(i=flatten) { i; }
number_slider = DoubleSlider(28, range=0..30 step 1)
byLengths_2 = Cuboid.ByLengths(height=number_slider)

# group: 필요한 양식으로 데이터 변환
area = Solid.Area(solid=byLengths_2)
string_from_object = FromObject(object=area)
code_block_4 = CodeBlock { " m2"; }
concat = String.Concat(string0=string_from_object, string1=code_block_4)
volume = Solid.Volume(solid=byLengths_2)
string_from_object_2 = FromObject(object=volume)
code_block_5 = CodeBlock { " m3"; }
concat_2 = String.Concat(string0=string_from_object_2, string1=code_block_5)

# group: Object(dictionary) 만들기 - 방법 1
code_block_6 = CodeBlock(geometry=byLengths_2, area=concat, volume=concat_2)
# ---------- code_block_6.designscript (5 lines) ----------
{
"geometry": _geometry,
"area": _area,
"volume": _volume
};
# ----------------------------------------

# group: Object(dictionary) 만들기 - 방법 2
code_block_7 = CodeBlock()
# ---------- code_block_7.designscript (5 lines) ----------
[
"geometry",
"area",
"volume"
];
# ----------------------------------------
list_create = List.Create(item0=byLengths_2, item1=concat, item2=concat_2)
byKeysValues = DesignScript.Builtin.Dictionary.ByKeysValues(keys=code_block_7, values=list_create)
